# Dynamo graph ColourFace - Copy.DYN "ColourFace - Copy.DYN" (Dynamo 2.0.2.6826)

file_path = Filename("..\FaceAlign\facepts.pts")
file_from_path = FileObject(path=file_path)
readText = FileSystem.ReadText(file=file_from_path)
string = StringInput("{\n")
split = String.Split(str=readText, separater0=string)
code_block = CodeBlock(list=split) { list[1]; }
length = String.Length(str=code_block)
code_block_2 = CodeBlock(count=length) { count-1; 1; }
remove = String.Remove(str=code_block, startIndex=code_block_2.out0, count=code_block_2.out1)
string_2 = StringInput("\n")
split_2 = String.Split(str=remove, separater0=string_2)
code_block_3 = CodeBlock { " "; }
split_3 = String.Split(str=split_2@L2, separater0=code_block_3)
code_block_4 = CodeBlock(t2=split_3) { t3 = List.GetItemAtIndex(t2@L2<1>, 0); }
toNumber = String.ToNumber(str=code_block_4)
code_block_5 = CodeBlock(t2=split_3) { t3 = List.GetItemAtIndex(t2@L2<1>, 1); }
toNumber_2 = String.ToNumber(str=code_block_5)
byCoordinates = Point.ByCoordinates(x=toNumber, y=toNumber_2)
code_block_6 = CodeBlock(l=byCoordinates) { l[0..67]; }
integer_slider = IntegerSlider(30, range=0..100 step 1)
code_block_7 = CodeBlock(l=code_block_6, n=integer_slider) { l[n]; }
ZAxis = Vector.ZAxis()
byOriginNormal = Plane.ByOriginNormal(origin=code_block_7, normal=ZAxis)
code_block_8 = CodeBlock { 0.5; }
scale = Geometry.Scale(geometry=code_block_6, plane=byOriginNormal, xamount=code_block_8, yamount=code_block_8)  # frozen
XY = Plane.XY()
file_path_2 = Filename("C:\Users\mauro\Desktop\HackstreetBoys\Hackstreet-Boys\FaceAlign\Images\pic.jpg")
file_from_path_2 = FileObject(path=file_path_2)
readFromFile = Image.ReadFromFile(file=file_from_path_2)
watch_image = WatchImageCore(image=readFromFile)
dimensions = Image.Dimensions(image=watch_image)
byWidthLength = Rectangle.ByWidthLength(plane=XY, width=dimensions.width, length=dimensions.height)
code_block_9 = CodeBlock(h=dimensions.width) { h/2; }
code_block_10 = CodeBlock(w=dimensions.height) { w/2; }
translate = Geometry.Translate(geometry=byWidthLength, xTranslation=code_block_9, yTranslation=code_block_10)
byPatch = Surface.ByPatch(closedCurve=translate)
scale_2 = Geometry.Scale(geometry=byPatch, plane=byOriginNormal, xamount=code_block_8, yamount=code_block_8)
code_block_11 = CodeBlock { 10; }
code_block_12 = CodeBlock(u=dimensions.width, n=code_block_11) { 0..1..#u/n; }
code_block_13 = CodeBlock(v=dimensions.height, n=code_block_11) { 0..1..#v/n; }
pointAtParameter = Surface.PointAtParameter(surface=scale_2, u=code_block_12, v=code_block_13, lacing=CrossProduct)
ZAxis_2 = Vector.ZAxis()
project = Point.Project(point=pointAtParameter, projectionDirection=ZAxis_2)  # frozen; unwired: baseGeometry
file_path_3 = Filename("..\FaceMeshOutput\FaceMesh.obj")
importFile = Autodesk.Dynamo.MeshToolkit.Mesh.ImportFile(fileName=file_path_3)
XZ = Plane.XZ()
mirror = Autodesk.Dynamo.MeshToolkit.Mesh.Mirror(mesh=importFile, mirrorPlane=XZ)
origin = Point.Origin()
byTwoPoints = Vector.ByTwoPoints(start=origin, end=code_block_7)
distanceTo = Geometry.DistanceTo(geometry=code_block_7, other=origin)
translate_2 = Autodesk.Dynamo.MeshToolkit.Mesh.Translate(mesh=mirror, vector=byTwoPoints, distance=distanceTo)
code_block_14 = CodeBlock { 3500; }
reduce = Autodesk.Dynamo.MeshToolkit.Mesh.Reduce(mesh=translate_2, triangleCount=code_block_14)
triangleCount = Autodesk.Dynamo.MeshToolkit.Mesh.TriangleCount()  # unwired: mesh
ZAxis_3 = Vector.ZAxis()
code_block_15 = CodeBlock { -100; }
byStartPointDirectionLength = Line.ByStartPointDirectionLength(direction=ZAxis_3, length=code_block_15)  # unwired: startPoint
flatten = List.Flatten(list=byStartPointDirectionLength)
code_block_16 = CodeBlock { 0; }
code_block_17 = CodeBlock(w=dimensions.width, n=code_block_11, h=dimensions.height) { w/n; h/n; }
pixels = Image.Pixels(image=watch_image, xSamples=code_block_17.out0, ySamples=code_block_17.out1)
watch = Watch(pixels)
transpose = List.Transpose(lists=watch)
byGeometryColor = Modifiers.GeometryColor.ByGeometryColor(geometry=pointAtParameter, color=transpose)
flatten_2 = List.Flatten(list=byGeometryColor)
triangles = Autodesk.Dynamo.MeshToolkit.Mesh.Triangles(mesh=translate_2)
flatten_3 = List.Flatten(list=triangles)
flatten_4 = List.Flatten(list=transpose)
flatten_5 = List.Flatten(list=pointAtParameter)
string_from_object = FromObject(obj=flatten_5)
u = Object.Identity(obj=code_block_12)
restOfItems = List.RestOfItems(list=u)
minimumItem = List.MinimumItem(list=restOfItems)
code_block_18 = CodeBlock { 0.5; }
pointAtParameter_2 = Surface.PointAtParameter(surface=triangles, u=code_block_18, v=code_block_18)
X = Point.X(point=pointAtParameter_2)
Y = Point.Y(point=pointAtParameter_2)
byCoordinates_2 = Point.ByCoordinates(x=X, y=Y)
flatten_6 = List.Flatten(list=byCoordinates_2)
UVParameterAtPoint = Surface.UVParameterAtPoint(surface=scale_2, point=flatten_6)
U = UV.U(uV=UVParameterAtPoint)
div = U / minimumItem
round = Math.Round(number=div)
mul = minimumItem * round
v = Object.Identity(obj=code_block_13)
restOfItems_2 = List.RestOfItems(list=v)
minimumItem_2 = List.MinimumItem(list=restOfItems_2)
V = UV.V(uV=UVParameterAtPoint)
div_2 = V / minimumItem_2
round_2 = Math.Round(number=div_2)
mul_2 = minimumItem_2 * round_2
pointAtParameter_3 = Surface.PointAtParameter(surface=scale_2, u=mul, v=mul_2)
string_from_object_2 = FromObject(obj=pointAtParameter_3)
indexOf = List.IndexOf(list=string_from_object, element=string_from_object_2)
getItemAtIndex = List.GetItemAtIndex(list=flatten_4, index=indexOf)
byGeometryColor_2 = Modifiers.GeometryColor.ByGeometryColor(geometry=flatten_3, color=getItemAtIndex)
code_block_19 = CodeBlock { 5; }
