# Dynamo custom node MeshToFace.dyf "MeshByFace.Texture" (Dynamo 2.0.2.6826)
# category: HackStreetBoys
# Directly from the Dynamo Hackaton the Mesh By Face by the Hackstreet Boys!

input = Input(input: var[]..[])
get_files = Python(IN[0]=input)
# ---------- get_files.python (21 lines) ----------
# Enable Python support and load DesignScript library
import clr
import sys

clr.AddReference('IronPython')
sys.path.append(r'C:\\Program Files (x86)\\IronPython 2.7\\Lib')

import os

timestamp = IN[0]

username = os.environ.get("USERNAME")
path = "C:\\Users\\{}\\AppData\\Local\\FaceMesh\\".format(username)
image = path + "Images\\" + timestamp + ".jpg"
ptsfile = path + "facepts_" + timestamp + ".pts"
objpath = path + "FaceMeshOutput\\FaceMesh_" + timestamp + ".obj"

# Place your code below this line

# Assign your output to the OUT variable.
OUT = objpath,ptsfile,image
# ----------------------------------------
code_block = CodeBlock(l=get_files) { l[0]; l[1]; l[2]; }

# group: MESH 3D FACE POINTS
file_from_path = FileObject(path=code_block.out1)
readText = FileSystem.ReadText(file=file_from_path)
string = StringInput("{\n")
split = String.Split(str=readText, separater0=string)
length = String.Length(str=split)
code_block_2 = CodeBlock(count=length) { count-1; 1; }
remove = String.Remove(str=split, startIndex=code_block_2.out0, count=code_block_2.out1)
code_block_3 = CodeBlock(p=remove) { p[1]; }
string_2 = StringInput("\n")
split_2 = String.Split(str=code_block_3, separater0=string_2)
code_block_4 = CodeBlock { " "; }
split_3 = String.Split(str=split_2@L2, separater0=code_block_4)
code_block_5 = CodeBlock(t2=split_3) { t3 = List.GetItemAtIndex(t2@L2<1>, 0); }
code_block_6 = CodeBlock(t2=split_3) { t3 = List.GetItemAtIndex(t2@L2<1>, 1); }

MeshCount = Input(MeshCount: double = 3000)

# group: MESH ADJUST
importFile = Autodesk.Dynamo.MeshToolkit.Mesh.ImportFile(fileName=code_block.out0)
XZ = Plane.XZ()
mirror = Autodesk.Dynamo.MeshToolkit.Mesh.Mirror(mesh=importFile, mirrorPlane=XZ)
toNumber = String.ToNumber(str=code_block_5)
toNumber_2 = String.ToNumber(str=code_block_6)
byCoordinates = Point.ByCoordinates(x=toNumber, y=toNumber_2)
code_block_7 = CodeBlock(p=byCoordinates) { p[0..67]; }
code_block_8 = CodeBlock(p=code_block_7) { p[30]; }
code_block_9 = CodeBlock(p=code_block_7) { p[8]; }
byStartPointEndPoint = Line.ByStartPointEndPoint(startPoint=code_block_8, endPoint=code_block_9)
length_2 = Curve.Length(curve=byStartPointEndPoint)
vertices = Autodesk.Dynamo.MeshToolkit.Mesh.Vertices(mesh=importFile)
flatten = List.Flatten(list=vertices)
Y = Point.Y(point=flatten)
minimumItem = List.MinimumItem(list=Y)
byCoordinates_2 = Point.ByCoordinates(y=minimumItem)
origin = Point.Origin()
byStartPointEndPoint_2 = Line.ByStartPointEndPoint(startPoint=byCoordinates_2, endPoint=origin)
length_3 = Curve.Length(curve=byStartPointEndPoint_2)
code_block_10 = CodeBlock(a=length_2, b=length_3) { a/b; }
scale = Autodesk.Dynamo.MeshToolkit.Mesh.Scale(mesh=mirror, scaleFactor=code_block_10)
code_block_11 = CodeBlock { 1; }
byCoordinates_3 = Vector.ByCoordinates(z=code_block_11)
direction = Line.Direction(line=byStartPointEndPoint_2)
direction_2 = Line.Direction(line=byStartPointEndPoint)
angleWithVector = Vector.AngleWithVector(vector=direction, otherVector=direction_2)
rotate = Autodesk.Dynamo.MeshToolkit.Mesh.Rotate(mesh=scale, axis=byCoordinates_3, degrees=angleWithVector)
byTwoPoints = Vector.ByTwoPoints(start=origin, end=code_block_8)
translate = Autodesk.Dynamo.MeshToolkit.Mesh.Translate(mesh=rotate, vector=byTwoPoints)
reduce = Autodesk.Dynamo.MeshToolkit.Mesh.Reduce(mesh=translate, triangleCount=MeshCount)
triangles = Autodesk.Dynamo.MeshToolkit.Mesh.Triangles(mesh=reduce)

# group: GET IMAGE COLORS AND PIXELS
file_from_path_2 = FileObject(path=code_block.out2)
readFromFile = Image.ReadFromFile(file=file_from_path_2)
watch_image = WatchImageCore(image=readFromFile)
dimensions = Image.Dimensions(image=watch_image)
reduce_pixel_by_percentage = CodeBlock { 10; }
code_block_12 = CodeBlock(w=dimensions.width, n=reduce_pixel_by_percentage, h=dimensions.height) { w/n; h/n; }
pixels = Image.Pixels(image=watch_image, xSamples=code_block_12.out0, ySamples=code_block_12.out1)
transpose = List.Transpose(lists=pixels)
XY = Plane.XY()
byWidthLength = Rectangle.ByWidthLength(plane=XY, width=dimensions.width, length=dimensions.height)
code_block_13 = CodeBlock(h=dimensions.width) { h/2; }
code_block_14 = CodeBlock(w=dimensions.height) { w/2; }
translate_2 = Geometry.Translate(geometry=byWidthLength, xTranslation=code_block_13, yTranslation=code_block_14)
byPatch = Surface.ByPatch(closedCurve=translate_2)
code_block_15 = CodeBlock(u=dimensions.width, n=reduce_pixel_by_percentage) { 0..1..#u/n; }
code_block_16 = CodeBlock(v=dimensions.height, n=reduce_pixel_by_percentage) { 0..1..#v/n; }
pointAtParameter = Surface.PointAtParameter(surface=byPatch, u=code_block_15, v=code_block_16, lacing=CrossProduct)

flatten_2 = List.Flatten(list=transpose)

# group: FACE3D POINTS
code_block_17 = CodeBlock { 0.5; }
pointAtParameter_2 = Surface.PointAtParameter(surface=triangles, u=code_block_17, v=code_block_17)
X = Point.X(point=pointAtParameter_2)
Y_2 = Point.Y(point=pointAtParameter_2)
byCoordinates_4 = Point.ByCoordinates(x=X, y=Y_2)
flatten_3 = List.Flatten(list=byCoordinates_4)

# group: FACE 3D POINTS ALIGNMENT TO THE GRID
flatten_4 = List.Flatten(list=pointAtParameter)
string_from_object = FromObject(obj=flatten_4)
u = Object.Identity(obj=code_block_15)
restOfItems = List.RestOfItems(list=u)
minimumItem_2 = List.MinimumItem(list=restOfItems)
UVParameterAtPoint = Surface.UVParameterAtPoint(surface=byPatch, point=flatten_3)
U = UV.U(uV=UVParameterAtPoint)
div = U / minimumItem_2
round = Math.Round(number=div)
mul = minimumItem_2 * round
v = Object.Identity(obj=code_block_16)
restOfItems_2 = List.RestOfItems(list=v)
minimumItem_3 = List.MinimumItem(list=restOfItems_2)
V = UV.V(uV=UVParameterAtPoint)
div_2 = V / minimumItem_3
round_2 = Math.Round(number=div_2)
mul_2 = minimumItem_3 * round_2
pointAtParameter_3 = Surface.PointAtParameter(surface=byPatch, u=mul, v=mul_2)
string_from_object_2 = FromObject(obj=pointAtParameter_3)
indexOf = List.IndexOf(list=string_from_object, element=string_from_object_2)

# group: GEOMETRY COLOR
flatten_5 = List.Flatten(list=triangles)
getItemAtIndex = List.GetItemAtIndex(list=flatten_2, index=indexOf)
byGeometryColor = Modifiers.GeometryColor.ByGeometryColor(geometry=flatten_5, color=getItemAtIndex)

MeshFace = Output(byGeometryColor)
byMeshColor = Autodesk.Dynamo.MeshToolkit.Display.MeshDisplay.ByMeshColor()  # unwired: mesh, meshColoring
explode = Autodesk.Dynamo.MeshToolkit.Mesh.Explode()  # unwired: mesh
