# Dynamo graph ColourFace_2.DYN "ColourFace_2.DYN" (Dynamo 2.0.2.6826)

# group: INPUTS
file_path = Filename("..\FaceMeshOutput\FaceMesh.obj")
file_path_2 = Filename("..\FaceAlign\facepts.pts")
file_path_3 = Filename("C:\Users\mauro\Desktop\HackstreetBoys\Hackstreet-Boys\FaceAlign\Images\pic.jpg")

importFile = Autodesk.Dynamo.MeshToolkit.Mesh.ImportFile(fileName=file_path)
XZ = Plane.XZ()
mirror = Autodesk.Dynamo.MeshToolkit.Mesh.Mirror(mesh=importFile, mirrorPlane=XZ)
origin = Point.Origin()
file_from_path = FileObject(path=file_path_2)
code_block = CodeBlock(t9=file_from_path)
# ---------- code_block.designscript (23 lines) ----------
t8 = FileSystem.ReadText(t9);
t10 = "{
";
t11 = String.Split(t8, [t10]);
list = t11;
t7 = Get.ValueAtIndex(list, 1);
t12 = String.Length(t7);
count = t12;
t5 = count - 1;
t13 = String.Remove(t7, t5, 1);
t14 = "
";
t15 = String.Split(t13, [t14]);
t16 = String.Split(t15@L2<1>, [" "]);
t2 = t16;
t3 = List.GetItemAtIndex(t2@L2<1>, 0);
t17 = String.ToNumber(t3);
t21 = t16;
t31 = List.GetItemAtIndex(t21@L2<1>, 1);
t18 = String.ToNumber(t31);
point1 = Autodesk.Point.ByCoordinates(t17, t18);
l = point1;
t1 = Get.ValueAtIndex(l, 0..67);
# ----------------------------------------
integer_slider = IntegerSlider(30, range=0..100 step 1)
code_block_2 = CodeBlock(l=code_block.t1, n=integer_slider) { l[n]; }
byTwoPoints = Vector.ByTwoPoints(start=origin, end=code_block_2)
distanceTo = Geometry.DistanceTo(geometry=code_block_2, other=origin)
translate = Autodesk.Dynamo.MeshToolkit.Mesh.Translate(mesh=mirror, vector=byTwoPoints, distance=distanceTo)

# group: MESH REDUCE
code_block_3 = CodeBlock { 3500; }
reduce = Autodesk.Dynamo.MeshToolkit.Mesh.Reduce(mesh=translate, triangleCount=code_block_3)
triangles = Autodesk.Dynamo.MeshToolkit.Mesh.Triangles(mesh=reduce)

flatten = List.Flatten(list=triangles)
file_from_path_2 = FileObject(path=file_path_3)
readFromFile = Image.ReadFromFile(file=file_from_path_2)
watch_image = WatchImageCore(image=readFromFile)
dimensions = Image.Dimensions(image=watch_image)
reduce_pixel_by_percentage = CodeBlock { 10; }
code_block_4 = CodeBlock(w=dimensions.width, n=reduce_pixel_by_percentage, h=dimensions.height) { w/n; h/n; }
pixels = Image.Pixels(image=watch_image, xSamples=code_block_4.out0, ySamples=code_block_4.out1)
transpose = List.Transpose(lists=pixels)
flatten_2 = List.Flatten(list=transpose)
XY = Plane.XY()
byWidthLength = Rectangle.ByWidthLength(plane=XY, width=dimensions.width, length=dimensions.height)
code_block_5 = CodeBlock(h=dimensions.width) { h/2; }
code_block_6 = CodeBlock(w=dimensions.height) { w/2; }
translate_2 = Geometry.Translate(geometry=byWidthLength, xTranslation=code_block_5, yTranslation=code_block_6)
byPatch = Surface.ByPatch(closedCurve=translate_2)
ZAxis = Vector.ZAxis()
byOriginNormal = Plane.ByOriginNormal(origin=code_block_2, normal=ZAxis)
code_block_7 = CodeBlock { 0.5; }
scale = Geometry.Scale(geometry=byPatch, plane=byOriginNormal, xamount=code_block_7, yamount=code_block_7)
code_block_8 = CodeBlock(u=dimensions.width, n=reduce_pixel_by_percentage) { 0..1..#u/n; }
code_block_9 = CodeBlock(v=dimensions.height, n=reduce_pixel_by_percentage) { 0..1..#v/n; }
pointAtParameter = Surface.PointAtParameter(surface=scale, u=code_block_8, v=code_block_9, lacing=CrossProduct)
flatten_3 = List.Flatten(list=pointAtParameter)
string_from_object = FromObject(obj=flatten_3)
u = Object.Identity(obj=code_block_8)
restOfItems = List.RestOfItems(list=u)
minimumItem = List.MinimumItem(list=restOfItems)
code_block_10 = CodeBlock { 0.5; }
pointAtParameter_2 = Surface.PointAtParameter(surface=triangles, u=code_block_10, v=code_block_10)
X = Point.X(point=pointAtParameter_2)
Y = Point.Y(point=pointAtParameter_2)
byCoordinates = Point.ByCoordinates(x=X, y=Y)
flatten_4 = List.Flatten(list=byCoordinates)
UVParameterAtPoint = Surface.UVParameterAtPoint(surface=scale, point=flatten_4)
U = UV.U(uV=UVParameterAtPoint)
div = U / minimumItem
round = Math.Round(number=div)
mul = minimumItem * round
v = Object.Identity(obj=code_block_9)
restOfItems_2 = List.RestOfItems(list=v)
minimumItem_2 = List.MinimumItem(list=restOfItems_2)
V = UV.V(uV=UVParameterAtPoint)
div_2 = V / minimumItem_2
round_2 = Math.Round(number=div_2)
mul_2 = minimumItem_2 * round_2
pointAtParameter_3 = Surface.PointAtParameter(surface=scale, u=mul, v=mul_2)
string_from_object_2 = FromObject(obj=pointAtParameter_3)
indexOf = List.IndexOf(list=string_from_object, element=string_from_object_2)
getItemAtIndex = List.GetItemAtIndex(list=flatten_2, index=indexOf)
byGeometryColor = Modifiers.GeometryColor.ByGeometryColor(geometry=flatten, color=getItemAtIndex)
