# Dynamo graph RotateMesh.DYN "RotateMesh.DYN" (Dynamo 2.0.2.6826)

file_path = Filename("..\AppData\Local\FaceMesh\FaceMeshOutput\FaceMesh.obj")
importFile = Autodesk.Dynamo.MeshToolkit.Mesh.ImportFile(fileName=file_path)
XZ = Plane.XZ()
mirror = Autodesk.Dynamo.MeshToolkit.Mesh.Mirror(mesh=importFile, mirrorPlane=XZ)
file_path_2 = Filename("..\AppData\Local\FaceMesh\facepts.pts")
file_from_path = FileObject(path=file_path_2)
readText = FileSystem.ReadText(file=file_from_path)
string = StringInput("{\n")
split = String.Split(str=readText, separater0=string)
length = String.Length(str=split)
code_block = CodeBlock(count=length) { count-1; 1; }
remove = String.Remove(str=split, startIndex=code_block.out0, count=code_block.out1)
code_block_2 = CodeBlock(p=remove) { p[1]; }
string_2 = StringInput("\n")
split_2 = String.Split(str=code_block_2, separater0=string_2)
code_block_3 = CodeBlock { " "; }
split_3 = String.Split(str=split_2@L2, separater0=code_block_3)
code_block_4 = CodeBlock(t2=split_3) { t3 = List.GetItemAtIndex(t2@L2<1>, 0); }
toNumber = String.ToNumber(str=code_block_4)
code_block_5 = CodeBlock(t2=split_3) { t3 = List.GetItemAtIndex(t2@L2<1>, 1); }
toNumber_2 = String.ToNumber(str=code_block_5)
byCoordinates = Point.ByCoordinates(x=toNumber, y=toNumber_2)
code_block_6 = CodeBlock(p=byCoordinates) { p[0..67]; }
code_block_7 = CodeBlock(p=code_block_6) { p[30]; }
code_block_8 = CodeBlock(p=code_block_6) { p[8]; }
byStartPointEndPoint = Line.ByStartPointEndPoint(startPoint=code_block_7, endPoint=code_block_8)
length_2 = Curve.Length(curve=byStartPointEndPoint)
vertices = Autodesk.Dynamo.MeshToolkit.Mesh.Vertices(mesh=importFile)
flatten = List.Flatten(list=vertices)
Y = Point.Y(point=flatten)
minimumItem = List.MinimumItem(list=Y)
byCoordinates_2 = Point.ByCoordinates(y=minimumItem)
origin = Point.Origin()
byStartPointEndPoint_2 = Line.ByStartPointEndPoint(startPoint=byCoordinates_2, endPoint=origin)
length_3 = Curve.Length(curve=byStartPointEndPoint_2)
code_block_9 = CodeBlock(a=length_2, b=length_3) { a/b; }
scale = Autodesk.Dynamo.MeshToolkit.Mesh.Scale(mesh=mirror, scaleFactor=code_block_9)
code_block_10 = CodeBlock { 1; }
byCoordinates_3 = Vector.ByCoordinates(z=code_block_10)
direction = Line.Direction(line=byStartPointEndPoint_2)
direction_2 = Line.Direction(line=byStartPointEndPoint)
angleWithVector = Vector.AngleWithVector(vector=direction, otherVector=direction_2)
rotate = Autodesk.Dynamo.MeshToolkit.Mesh.Rotate(mesh=scale, axis=byCoordinates_3, degrees=angleWithVector)
byTwoPoints = Vector.ByTwoPoints(start=origin, end=code_block_7)
translate = Autodesk.Dynamo.MeshToolkit.Mesh.Translate(mesh=rotate, vector=byTwoPoints)
